# Grasshopper definition GH_AR-AssistedRoboticWelding.gh (Grasshopper 1.0.7)
# plug-ins: Robots, Fologram for Grasshopper, Fologram For Grasshopper Utilities, G E N E R A T I O N, MetaHopper

input_offsetdistance_mm = Slider(27, range=1..200)
input_offsetdistance_mm_2 = Data(input_offsetdistance_mm)

input_visualiserobotpath = Button()

Z = UnitZ(Factor=Slider(40, range=0..100))
input_vec_textoffsetvalue = Data(Z)

input_robotupload = Button()
input_robotplay = Button()
input_robotpause = Button()
input_robotupload_2 = Data(input_robotupload)
input_robotpause_2 = Data(input_robotpause)
input_robotplay_2 = Data(input_robotplay)
input_ip = Data("192.168.1.175")

input_textsize = Data(Slider(9, range=0..100))

list = RobotsLibrary(
    {"ABB CRB15000-5", "ABB CRB15000-10", "ABB CRB15000-12", "UR3e", "UR5e", "UR10e", "UR16e", "UR3", "UR5", "UR10"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}, selected="UR10",
    Type=0)
list_2 = FlagFields({"Shoulder": 1, "Elbow": 2, "Wrist": 4}, selected="Shoulder")
cluster = Cluster()
list_3 = ValueList({"Joint", "Linear"}, selected="Linear")
input_robotspeed_s = Slider(10, range=0..1000)
input_rotationangle = Slider(20, range=0..90)
cluster_2 = Cluster_16(
    N=list,
    input_robotconfiguration=list_2,
    input_robotspeed=input_robotspeed_s,
    input_robottool=cluster,
    input_rotationangle=input_rotationangle,
    input_robotmotion=list_3)  # -> input_robottype_2, input_robotconfiguration_3, input_robotspeed_5, input_robottool_3, input_rotationangle_3, input_robotmotion_3, output_robottarget_homing

docinfo = DocumentInfo(AutoUpdate=False, Recursive=False)  # -> DocumentName, DocumentFilePath, Components, Params, _3rdPartyAssemblies
input_visualiserobotpath_2 = Data(input_visualiserobotpath)
panel = Panel(docinfo._3rdPartyAssemblies)
list_4 = ValueList({"Welding Line": 2, "Spot Welding": 3}, selected="Welding Line")
linear_true_spline_false = BooleanToggle(True)
T = StateGate(States=list_4, LinkTarget=linear_true_spline_false)
T_2 = StateGate(States=list_4)  # -> False, StateGroup
augdoc = AugmentedDocument(
    augmented_trigger_0_key=input_robotupload,
    augmented_trigger_1_key=input_numberofpoints,
    augmented_trigger_2_key=list_4,
    augmented_trigger_3_key=input_visualiserobotpath,
    augmented_trigger_4_key=input_offsetdistance_mm,
    augmented_trigger_5_key=input_rotationangle,
    augmented_trigger_6_key=linear_true_spline_false,
    num_augmented_triggers=7)
crv = Curve(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)

input_numberofpoints = Slider(4, range=2..10)
input_numberofpoints_2 = Data(input_numberofpoints)

interaction = InteractionType(7)
cluster_3 = Cluster_10(crv=crv, input_numberofpoints=input_numberofpoints_2)
sync = SyncGeometry(Geometry=cluster_3, Interactions=interaction)
cluster_4 = Cluster_11(mesh=sync)

cluster_5 = Cluster_6(
    output_adjustedpoints=cluster_4,
    input_rotationangle=cluster_2.input_rotationangle_3,
    input_offsetdistance_mm=input_offsetdistance_mm_2)  # -> output_offsetpln_2, R, output_interwovenpath_crv_2; disabled
cluster_6 = Cluster_3(output_adjustedpoints=cluster_4, input_vec_textoffsetvalue=input_vec_textoffsetvalue, input_textsize=input_textsize)  # -> S, G, input_textsize_3; disabled
output_interwovenpln = Data(cluster_5.R)  # disabled

cluster_7 = Cluster_9(
    type_linear_spline=linear_true_spline_false,
    output_adjustedpoints=cluster_4,
    input_rotationangle=cluster_2.input_rotationangle_3,
    input_offsetdistance_mm=input_offsetdistance_mm_2)  # -> C, pl, output_interwovenpln_2

cluster_8 = Cluster_7(output_adjustedpoints=cluster_4, input_vec_textoffsetvalue=input_vec_textoffsetvalue, input_textsize=input_textsize)  # -> input_text_2, input_point_2, input_textsize_3
text_dot = ConstructTextDot(Text=cluster_8.input_text_2, Point=cluster_8.input_point_2, Size=cluster_8.input_textsize_3)
sync_2 = SyncGeometry(Geometry=text_dot)

output_offsetstartingnendingpln = Data(cluster_7.pl)
input_secondarycolorswatches = Data(RGBA(255, 255, 255, 40))
msphere = MeshSphere(Base=output_offsetstartingnendingpln, Radius=10, UCount=10, VCount=20)
sync_3 = SyncGeometry(Geometry=msphere, Material=input_secondarycolorswatches)

equals = Equality(FirstNumber=list_4, SecondNumber="1")  # -> Equality, Inequality
T_3 = StateGate(States=equals.Inequality, LinkTarget=input_numberofpoints)  # -> True, False

text_dot_2 = ConstructTextDot(Text=cluster_6.S, Point=cluster_6.G, Size=cluster_6.input_textsize_3)  # disabled
sync_4 = SyncGeometry(Geometry=text_dot_2)  # disabled

swatch = ColourSwatch(SwatchColor=RGBA(255, 255, 255, 40))  # disabled
msphere_2 = MeshSphere(Base=cluster_5.output_offsetpln_2, Radius=10, UCount=10, VCount=20)  # disabled
sync_5 = SyncGeometry(Geometry=msphere_2, Material=swatch)  # disabled

display = DisplayMode(1)
cluster_9 = Cluster_14(input_visualiserobotpath=input_visualiserobotpath_2)
trigger = Trigger(Interval=100, TimerInterval=100, Target=count)
merge = Merge(Data1=cluster_5.R, Data2=cluster_7.output_interwovenpln_2)  # -> flatten(Result)
output_interwovenpln_2 = Data(merge)

input_robottool = Data(cluster_2.input_robottool_3)
input_robotconfiguration = Data(cluster_2.input_robotconfiguration_3)
input_robotmotion = Data(cluster_2.input_robotmotion_3)
output_interwovenpln_3 = Data(output_interwovenpln_2)
input_robotspeed = Data(cluster_2.input_robotspeed_5)
target = CreateTarget(
    Plane=output_interwovenpln_3,
    RobConf=input_robotconfiguration,
    Motion=input_robotmotion,
    Tool=input_robottool,
    Speed=input_robotspeed,
    IsCartesian=True)
input_robottarget = Data(target)

input_robottarget_2 = Data(input_robottarget)
output_robottarget_homing = Data(cluster_2.output_robottarget_homing)
merge_2 = Merge(Data1=flatten(output_robottarget_homing), Data2=flatten(input_robottarget_2), Data3=flatten(output_robottarget_homing))  # -> flatten(Result)
output_robottargets = Data(merge_2)

input_robottarget_3 = Data(output_robottargets)
input_robottype = Data(cluster_2.input_robottype_2)
program = CreateProgram(Name="DefaultProgram", RobotSystem=input_robottype, Targets=input_robottarget_3, StepSize=1)  # -> Program, Code, Duration, Warnings, Errors
input_program = Data(program.Program)

input_robotpause_3 = Data(input_robotpause_2)
input_ip_2 = Data(input_ip)
input_robotplay_3 = Data(input_robotplay_2)
input_program_2 = Data(input_program)
input_robotupload_3 = Data(input_robotupload_2)
remote = RemoteConnection(Program=input_program_2, IP=input_ip_2, Upload=input_robotupload_3, Play=input_robotplay_3, Pause=input_robotpause_3)

output_robotprogram_error = Data(program.Errors)

output_robotprogram_error_2 = Data(output_robotprogram_error)
null = NullItem(Item=output_robotprogram_error_2)  # -> NullFlags, InvalidFlags, Description
avr = Average(Input=null.NullFlags)

count = Counter(Start=0, Step=0.1, Pause=False, Reset=cluster_9)
panel_2 = Panel(remote)
output_timer = Data(count)
output_error = Data(avr)
cluster_10 = Cluster_2(
    output_error=output_error,
    input_program_unfiltered=input_program,
    input_program_filtered=input_program_2,
    output_timer=output_timer)  # -> output_color_2, output_geometry_2
output_geometry = Data(cluster_10.output_geometry_2)
output_color = Data(cluster_10.output_color_2)
output_color_2 = Data(cluster_10.output_color_2)
T_4 = StateGate(States=output_error, LinkTarget=input_program_2)
sync_6 = SyncGeometry(Geometry=output_geometry, Material=output_color_2, DisplayMode=display)
merge_3 = Merge(Data1=cluster_5.output_interwovenpath_crv_2, Data2=flatten(cluster_7.C))  # -> flatten(OUTPUT_RobotToolpath_Crv)

cluster_11 = Cluster_13(output_robotprogram_error=output_robotprogram_error)
cluster_12 = Cluster_12(output_interwovenpath=merge_3, F=input_vec_textoffsetvalue)
input_textsize_2 = Data(Slider(15, range=0..100))
text_dot_3 = ConstructTextDot(Text=cluster_11, Point=cluster_12, Size=input_textsize_2)
sync_7 = SyncGeometry(Geometry=text_dot_3, Material=output_color, DisplayMode=1)

output_color_3 = Data(cluster_10.output_color_2)
sync_8 = SyncGeometry(Geometry=merge_3, Material=output_color_3, DisplayMode=1)

# ==== cluster Cluster

neg = Negative(Value=Slider(50, range=0..1000))
neg_2 = Negative(Value=Slider(10, range=0..10))
xy = XYPlane(Origin=Point(0, 0, 0))
neg_3 = Negative(Value=Slider(15, range=0..100))
Z = UnitZ(Factor=neg)
Z_2 = UnitZ(Factor=neg_2)
pln = Plane(xy)
cir = Circle(Plane=xy, Radius=Slider(40, range=0..100))
Z_3 = UnitZ(Factor=neg_3)
move = Move(Geometry=pln, Motion=Z_2)  # -> Geometry, Transform
cir_2 = Circle(Plane=move.Geometry, Radius=Slider(20, range=0..100))
orient = Orient(Geometry=cir, Source=xy, Target=move.Geometry)  # -> Geometry, Transform
move_2 = Move(Geometry=move.Geometry, Motion=Z)  # -> Geometry, Transform
orient_2 = Orient(Geometry=cir_2, Source=move.Geometry, Target=move_2.Geometry)  # -> Geometry, Transform
number_slider = Slider(40, range=0..100)
loft = Loft(
    Curves=[orient_2.Geometry, cir_2],
    Options={Adjust=False, Closed=False, LoftEnds=0, LoftSimp=0, LoftType=0, Rebuild=10, Refit=0.01})
loft_2 = Loft(
    Curves=[orient.Geometry, cir],
    Options={Adjust=False, Closed=False, LoftEnds=0, LoftSimp=0, LoftType=0, Rebuild=10, Refit=0.01})
orient_3 = Orient(Geometry=cir, Source=xy, Target=move_2.Geometry)  # -> Geometry, Transform
move_3 = Move(Geometry=move_2.Geometry, Motion=Z_2)  # -> Geometry, Transform
cap = CapHoles(Brep=loft_2)
cap_2 = CapHoles(Brep=loft)
orient_4 = Orient(Geometry=cir, Source=xy, Target=move_3.Geometry)  # -> Geometry, Transform
cir_3 = Circle(Plane=move_3.Geometry, Radius=number_slider)
move_4 = Move(Geometry=move_3.Geometry, Motion=Z_3)  # -> Geometry, Transform
cir_4 = Circle(Plane=move_4.Geometry, Radius=number_slider)
loft_3 = Loft(
    Curves=[orient_3.Geometry, orient_4.Geometry],
    Options={Adjust=False, Closed=False, LoftEnds=0, LoftSimp=0, LoftType=0, Rebuild=10, Refit=0.01})
area = Area(Geometry=cir_3)  # -> Area, Centroid
curvepoint = PointOnCurve(cir_4, parameter=0.5)
rad = Radians(Degrees=Slider(45, range=0..100))
cap_3 = CapHoles(Brep=loft_3)
move_5 = Move(Geometry=area.Centroid, Motion=Z_3)  # -> Geometry, Transform
rtrig = RightTrigonometry(Alpha=rad, RLength=Slider(20, range=0..100))  # -> Alpha, Beta, PLength, QLength, RLength
rtrig_2 = RightTrigonometry(Alpha=rad, RLength=Slider(110, range=0..1000))  # -> Alpha, Beta, PLength, QLength, RLength
merge = Merge(Data1=cap, Data2=cap_2, Data3=cap_3)
pl_3pt = Plane3Pt(PointA=curvepoint, PointB=move_5.Geometry, PointC=area.Centroid)
neg_4 = Negative(Value=rtrig_2.PLength)
neg_5 = Negative(Value=rtrig_2.QLength)
transplane = TranslatedPlane(Plane=pl_3pt, XAmount=neg_4, YAmount=neg_5)
ln = Line(StartPoint=pl_3pt, EndPoint=transplane)
number_slider_2 = Slider(10, range=0..10)
transplane_2 = TranslatedPlane(Plane=transplane, XAmount=rtrig.PLength, YAmount=rtrig.QLength)
ext = ExtendCurve(Curve=ln, Type=0, Start=Slider(43, range=0..100), End=Slider(0, range=0..100))  # -> flatten(Curve)
deplane = DeconstructPlane(Plane=transplane)  # -> Origin, XAxis, YAxis, ZAxis
division = Division(A=Slider(30, range=0..30), B=2)
offset = OffsetCurve(Curve=ext, Distance=Slider(40, range=0..100), Corners=1)  # -> flatten(Curve)
amp = Amplitude(Vector=deplane.ZAxis, Amplitude=division)
loft_4 = Loft(Curves=[ext, offset], Options={Adjust=False, Closed=False, LoftEnds=0, LoftSimp=0, LoftType=0, Rebuild=10, Refit=0.01})
neg_6 = Negative(Value=amp)
merge_2 = Merge(Data1=amp, Data2=neg_6)
loft_5 = Loft(Curves=[cir_4, cir_3], Options={Adjust=False, Closed=False, LoftEnds=0, LoftSimp=0, LoftType=0, Rebuild=10, Refit=0.01})
move_6 = Move(Geometry=loft_4, Motion=merge_2)  # -> Geometry, Transform
cap_4 = CapHoles(Brep=loft_5)
loft_6 = Loft(Curves=move_6.Geometry, Options={Adjust=False, Closed=False, LoftEnds=0, LoftSimp=0, LoftType=0, Rebuild=10, Refit=0.01})
cap_5 = CapHoles(Brep=loft_6)
data = Data(cap_4)
data_2 = Data(merge)
data_3 = Data(cap_5)
merge_3 = Merge(Data1=data_2, Data2=data, Data3=data_3)
neg_7 = Negative(Value=Slider(55, range=0..100))
data_4 = Data(merge_3)
Z_4 = UnitZ(Factor=neg_7)
number_slider_3 = Slider(10, range=0..100)
rad_2 = Radians(Degrees=Slider(40, range=0..100))
neg_8 = Negative(Value=Slider(110, range=0..1000))
rtrig_3 = RightTrigonometry(Alpha=rad_2, RLength=Slider(125, range=0..1000))  # -> Alpha, Beta, PLength, QLength, RLength
neg_9 = Negative(Value=rtrig_3.QLength)
neg_10 = Negative(Value=rtrig_3.PLength)
number_slider_4 = Slider(0, range=0..360)
tweencrv = TweenCurve(CurveA=ext, CurveB=offset, Factor=0.5, BlendType=0)
crv_cp = CurveClosestPoint(Point=transplane_2, Curve=tweencrv)  # -> Point, Parameter, Distance
pl_origin = PlaneOrigin(Base=transplane, Origin=crv_cp.Point)
move_7 = Move(Geometry=pl_origin, Motion=Z_4)  # -> Geometry, Transform
pl_origin_2 = PlaneOrigin(Base=pl_origin, Origin=move_7.Geometry)
transplane_3 = TranslatedPlane(Plane=pl_origin_2, XAmount=neg_8)
transplane_4 = TranslatedPlane(Plane=transplane_3, XAmount=neg_10, YAmount=neg_9)
transplane_5 = TranslatedPlane(Plane=pl_origin_2, XAmount=Slider(120, range=0..1000))
merge_4 = Merge(Data1=transplane_4, Data2=transplane_3, Data3=transplane_5)  # -> flatten(Result)
pline = PolyLine(Vertices=merge_4, Closed=False)
pframe = PerpFrame(Curve=reparameterize(pline), Parameter=Slider(1, range=0..1))
pframe_2 = PerpFrame(Curve=reparameterize(pline), Parameter=Slider(0, range=0..1))
cir_5 = Circle(Plane=pframe_2, Radius=Slider(10, range=0..10))
swp1 = Sweep1(Rail=pline, Sections=cir_5, Miter=1)
cap_6 = CapHoles(Brep=swp1)
rotate = Rotate(Geometry=cap_6, Angle=degrees(number_slider_4), Plane=pframe)  # -> Geometry, Transform
list = ValueList({"Not Flipped": 0, "Flipped": 180}, selected="Not Flipped")
ln_2 = Line(StartPoint=move_7.Geometry, EndPoint=pl_origin)
number_slider_5 = Slider(0, range=-135..55)
rotate_2 = Rotate(Geometry=pframe_2, Angle=degrees(number_slider_4), Plane=pframe)  # -> Geometry, Transform
pipe = Pipe(Curve=ln_2, Radius=Slider(15, range=0..1000), Caps=2)
rot3d = Rotate3D(Geometry=rotate_2.Geometry, Angle=degrees(list), Center=pl_origin, Axis=tweencrv)  # -> Geometry, Transform
cap_7 = CapHoles(Brep=pipe)
merge_5 = Merge(Data1=cap_7, Data2=rotate.Geometry)  # -> flatten(Result)
rot3d_2 = Rotate3D(Geometry=merge_5, Angle=degrees(list), Center=pl_origin, Axis=tweencrv)  # -> Geometry, Transform
rotate_3 = Rotate(Geometry=rot3d_2.Geometry, Angle=degrees(number_slider_5), Plane=pl_origin)  # -> Geometry, Transform
sunion = SolidUnion(Breps=data_4)
sunion_2 = SolidUnion(Breps=rotate_3.Geometry)
merge_6 = Merge(Data1=sunion, Data2=sunion_2)  # -> flatten(Result)
sunion_3 = SolidUnion(Breps=merge_6)
mesh = Mesh(sunion_3)
mjoin = MeshJoin(Meshes=mesh)
list_2 = ValueList({"Not Flipped": 0, "Flipped": 180}, selected="Flipped")
rotate_4 = Rotate(Geometry=rot3d.Geometry, Angle=degrees(number_slider_5), Plane=pl_origin)  # -> Geometry, Transform
X = UnitX(Factor=1)
rot3d_3 = Rotate3D(Geometry=mjoin, Angle=degrees(list_2), Center=Point(0, 0, 0), Axis=X)  # -> Geometry, Transform
rot3d_4 = Rotate3D(Geometry=rotate_4.Geometry, Angle=degrees(list_2), Center=Point(0, 0, 0), Axis=X)  # -> Geometry, Transform
number_slider_6 = Slider(270, range=0..360)
prot = RotatePlane(Plane=rot3d_4.Geometry, Angle=degrees(Slider(360, range=0..1000)))
xy_2 = XYPlane(Origin=Point(0, 0, 0))
rotate_5 = Rotate(Geometry=rot3d_3.Geometry, Angle=degrees(number_slider_6), Plane=xy_2)  # -> Geometry, Transform
rotate_6 = Rotate(Geometry=prot, Angle=degrees(number_slider_6), Plane=xy_2)  # -> Geometry, Transform
input_heightmilibar_mm = Slider(35, range=0..1000)
bbox = BoundingBox(Content=rotate_5.Geometry, Plane=PlaneXY(0, 0, 0))  # -> Box, Box_2
neg_11 = Negative(Value=Slider(90, range=0..100))
box = EvaluateBox(Box=bbox.Box, UParameter=0.5, VParameter=0.5, WParameter=0.5)  # -> Plane, Point, Include
division_2 = Division(A=Slider(2100, range=0..10000), B="1000")
rotate_7 = Rotate(Geometry=rotate_5.Geometry, Angle=degrees(neg_11), Plane=PlaneXY(0, 0, 0))  # -> Geometry, Transform
rotate_8 = Rotate(Geometry=rotate_6.Geometry, Angle=degrees(neg_11), Plane=PlaneXY(0, 0, 0))  # -> Geometry, Transform
Z_5 = UnitZ(Factor=input_heightmilibar_mm)
Z_6 = UnitZ(Factor=input_heightmilibar_mm)
move_8 = Move(Geometry=rotate_8.Geometry, Motion=Z_5)  # -> Geometry, Transform
move_9 = Move(Geometry=rotate_7.Geometry, Motion=Z_6)  # -> Geometry, Transform
tool = CreateTool(Name="DefaultGHTool", TCP=move_8.Geometry, Weight=division_2, Centroid=box.Plane, Mesh=move_9.Geometry)  # -> Tool, TCP

T = ClusterOutput(tool.Tool)

# ==== cluster Cluster_2
input_program_filtered = ClusterInput()
output_timer = ClusterInput()
input_program_unfiltered = ClusterInput()
output_error = ClusterInput()
input_program_unfiltered_2 = Data(input_program_unfiltered)
output_error_2 = Data(output_error)
input_program_filtered_2 = Data(input_program_filtered)
output_timer_2 = Data(output_timer)
sim = ProgramSimulation(Program=input_program_unfiltered_2, Time=Slider(1, range=0..1), Normalized=True)  # -> SystemMeshes, JointRotations, Plane, Index, Time, Program, Errors
sim_2 = ProgramSimulation(Program=input_program_unfiltered_2, Time=0, Normalized=True)  # -> SystemMeshes, JointRotations, Plane, Index, Time, Program, Errors
sim_3 = ProgramSimulation(Program=input_program_filtered_2, Time=output_timer_2, Normalized=invert(True))  # -> SystemMeshes, JointRotations, Plane, Index, Time, Program, Errors

# ---- group: NO ERROR = 1
equals = Equality(FirstNumber=output_error_2, SecondNumber=1)  # -> Equality, Inequality

# ----
larger = LargerThan(FirstNumber=output_timer_2, SecondNumber=sim.Time)  # -> LargerThan, OrEqualTo
filter = StreamFilter(
    Gate=equals.Equality,
    Stream0=ColourSwatch(SwatchColor=RGBA(255, 0, 0, 91)),
    Stream1=ColourSwatch(SwatchColor=RGBA(255, 255, 255, 173)))
output_color = Data(filter)
output_color_2 = ClusterOutput(output_color)

# ---- group: timer =0 & no error
equals_2 = Equality(FirstNumber=output_timer_2, SecondNumber=Slider(0, range=0..100))  # -> Equality, Inequality

# ----
or = GateOr(A=equals_2.Equality, B=larger.LargerThan)

# ---- group: timer =0 & no error (continued)
filter_2 = StreamFilter(Gate=or, Stream0=sim_3.SystemMeshes)

# ----
filter_3 = StreamFilter(Gate=equals.Equality, Stream0=sim_2.SystemMeshes, Stream1=filter_2)
output_geometry = Data(filter_3)
output_geometry_2 = ClusterOutput(output_geometry)

# ==== cluster Cluster_3
input_vec_textoffsetvalue = ClusterInput()
output_adjustedpoints = ClusterInput()
input_vec_textoffsetvalue_2 = Data(input_vec_textoffsetvalue)
output_adjustedpoints_2 = Data(output_adjustedpoints)
series = Series(L=output_adjustedpoints_2)
move = Move(Geometry=output_adjustedpoints_2, Motion=input_vec_textoffsetvalue_2)  # -> Geometry, Transform
S = ClusterOutput(series)
G = ClusterOutput(move.Geometry)
input_textsize = ClusterInput()
input_textsize_2 = Data(input_textsize)
input_textsize_3 = ClusterOutput(input_textsize_2)

# ==== cluster Cluster_6
input_offsetdistance_mm = ClusterInput()
output_adjustedpoints = ClusterInput()
input_rotationangle = ClusterInput()
cluster = Cluster_4(output_adjustedpoints=output_adjustedpoints, input_rotationangle=input_rotationangle)
output_basedpln = Data(cluster)
cluster_2 = Cluster_5(output_basedpln=cluster, input_offsetdistance_mm=input_offsetdistance_mm)
output_offsetpln = Data(simplify(cluster_2))
merge = Merge(Data1=graft(output_offsetpln), Data2=graft(output_basedpln), Data3=graft(output_offsetpln))  # -> flatten(Result)
output_interwovenpln = Data(merge)
pline = PolyLine(Vertices=output_interwovenpln, Closed=False)
output_interwovenpath_crv = Data(pline)
R = ClusterOutput(merge)
output_offsetpln_2 = ClusterOutput(cluster_2)
output_interwovenpath_crv_2 = ClusterOutput(output_interwovenpath_crv)

# ==== cluster Cluster_7
output_adjustedpoints = ClusterInput()
output_adjustedpoints_2 = Data(output_adjustedpoints)
lng = ListLength(List=output_adjustedpoints_2)
input_vec_textoffsetvalue = ClusterInput()
input_textsize = ClusterInput()
dom = ConstructDomain(DomainStart=1, DomainEnd=lng)
input_vec_textoffsetvalue_2 = Data(input_vec_textoffsetvalue)
input_textsize_2 = Data(input_textsize)
range = Range(Domain=dom, Steps=expr("x-1", lng))
move = Move(Geometry=output_adjustedpoints_2, Motion=input_vec_textoffsetvalue_2)  # -> Geometry, Transform
input_textsize_3 = ClusterOutput(input_textsize_2)
input_text = Data(range)
input_point = Data(move.Geometry)
input_text_2 = ClusterOutput(input_text)
input_point_2 = ClusterOutput(input_point)

# ==== cluster Cluster_9
type_linear_spline = ClusterInput()
output_adjustedpoints = ClusterInput()
input_offsetdistance_mm = ClusterInput()
input_rotationangle = ClusterInput()
type_linear_spline_2 = Data(type_linear_spline)
output_adjustedpoints_2 = Data(output_adjustedpoints)
input_offsetdistance_mm_2 = Data(input_offsetdistance_mm)
input_rotationangle_2 = Data(input_rotationangle)
pline = PolyLine(Vertices=output_adjustedpoints_2, Closed=False)  # -> reparameterize(Polyline)
xy = XYPlane(Origin=output_adjustedpoints_2)
cluster = Cluster_8(V=output_adjustedpoints_2)  # -> output_interpolatedcrv_2, output_splinepln_2
filter = StreamFilter(Gate=type_linear_spline_2, Stream0=pline, Stream1=cluster.output_interpolatedcrv_2)
filter_2 = StreamFilter(Gate=type_linear_spline_2, Stream0=xy, Stream1=cluster.output_splinepln_2)
deplane = DeconstructPlane(Plane=filter_2)  # -> Origin, XAxis, YAxis, ZAxis
rot3d = Rotate3D(Geometry=filter_2, Angle=degrees(input_rotationangle_2), Center=filter_2, Axis=deplane.XAxis)  # -> Geometry, Transform
output_crv = Data(filter)
item = ListItem(List=rot3d.Geometry, Index=[0, -1], Wrap=True)
output_robotpathway = Data(rot3d.Geometry)
output_robotpathway_2 = Data(output_robotpathway)
output_startingnendingpln = Data(item)
output_startingnendingpln_2 = Data(output_startingnendingpln)
pl_offset = PlaneOffset(BasePlane=output_startingnendingpln_2, Offset=input_offsetdistance_mm_2)
output_offsetstartingnendingpln = Data(pl_offset)
output_offsetstartingnendingpln_2 = Data(output_offsetstartingnendingpln)
dispatch = Dispatch(List=output_offsetstartingnendingpln_2, DispatchPattern=[True, False])  # -> ListA, ListB
merge = Merge(Data1=dispatch.ListA, Data2=output_robotpathway_2, Data3=dispatch.ListB)
pl = ClusterOutput(pl_offset)
output_interwovenpln = Data(merge)
output_interwovenpln_2 = ClusterOutput(output_interwovenpln)
output_startingnendingpln_3 = Data(output_startingnendingpln)
output_offsetstartingnendingpln_3 = Data(output_offsetstartingnendingpln)
ln = Line(StartPoint=output_startingnendingpln_3, EndPoint=output_offsetstartingnendingpln_3)
merge_2 = Merge(Data1=output_crv, Data2=ln)
join = JoinCurves(Curves=merge_2, Preserve=False)
C = ClusterOutput(join)

# ==== cluster Cluster_10
crv = ClusterInput()
input_numberofpoints = ClusterInput()
crv_2 = Curve(crv)
input_numberofpoints_2 = Data(input_numberofpoints)
subtraction = Subtraction(A=input_numberofpoints_2, B=1)
hframes = HorizontalFrames(Curve=crv_2, Count=subtraction)  # -> Frames, Parameters
msphere = MeshSphere(Base=hframes.Frames, Radius=10, UCount=10, VCount=20)
M = ClusterOutput(msphere)

# ==== cluster Cluster_11
mesh = ClusterInput()
mesh_2 = Mesh(mesh)
volume = Volume(Geometry=mesh_2)  # -> Volume, Centroid
output_adjustedpoints = Data(volume.Centroid)
output_adjustedpoints_2 = ClusterOutput(output_adjustedpoints)

# ==== cluster Cluster_12
output_interwovenpath = ClusterInput()
output_interwovenpath_2 = Data(output_interwovenpath)
bbox = BoundingBox(Content=output_interwovenpath_2, Plane=PlaneXY(0, 0, 0), UnionBox=True)  # -> Box, Box_2
box = EvaluateBox(Box=bbox.Box, UParameter=0.5, VParameter=0.5, WParameter=1)  # -> Plane, Point, Include
F = ClusterInput()
Z = UnitZ(Factor=F)
move = Move(Geometry=box.Plane, Motion=Z)  # -> Geometry, Transform
G = ClusterOutput(move.Geometry)

# ==== cluster Cluster_13
output_robotprogram_error = ClusterInput()
output_robotprogram_error_2 = Data(output_robotprogram_error)
null = NullItem(Item=output_robotprogram_error_2)  # -> NullFlags, InvalidFlags, Description
avr = Average(Input=null.NullFlags)
expression = Expression(x=avr, Expression="if(x=0,\"robot will not proceed\",\"good to proceed\")")
R = ClusterOutput(expression)

# ==== cluster Cluster_14
input_visualiserobotpath = ClusterInput()
input_visualiserobotpath_2 = Data(input_visualiserobotpath)
rec = DataRecorder(input_visualiserobotpath_2, DataLimit=-10, RecordData=True)
ma = MassAddition(Input=rec)  # -> Result, PartialResults
equals = Equality(FirstNumber=ma.Result, SecondNumber=0)  # -> Equality, Inequality
filter = StreamFilter(Gate=equals.Equality, Stream0=input_visualiserobotpath_2, Stream1=True)
s_1 = ClusterOutput(filter)

# ==== cluster Cluster_16
input_robotmotion = ClusterInput()
input_robottool = ClusterInput()
N = ClusterInput()
input_robotmotion_2 = Data(input_robotmotion)
input_robotspeed = ClusterInput()
input_robotconfiguration = ClusterInput()
input_rotationangle = ClusterInput()
input_robottool_2 = Data(input_robottool)

loadrobot = LoadRobotSystem(Name=N, Base=PlaneXY(0, 0, 0))
input_robottype = Data(loadrobot)

input_robotspeed_2 = Data(input_robotspeed)
cluster = Cluster_15(input_robotsystem=input_robottype, input_robot_tool=input_robottool_2, input_robot_speed=input_robotspeed_2)

input_robotspeed_3 = Data(input_robotspeed_2)
speed = CreateSpeed(
    Translation=input_robotspeed_3,
    Rotation=3.141592654,
    ExternalTranslation=5000,
    ExternalRotation=18.84955592,
    AccelTranslation=2500,
    AccelAxis=12.56637061)
input_robotspeed_4 = Data(speed)

input_robotconfiguration_2 = Data(input_robotconfiguration)
input_rotationangle_2 = Data(input_rotationangle)
input_robotmotion_3 = ClusterOutput(input_robotmotion_2)
input_robottool_3 = ClusterOutput(input_robottool_2)
output_robottarget_homing = ClusterOutput(cluster)
input_robotspeed_5 = ClusterOutput(input_robotspeed_4)
input_rotationangle_3 = ClusterOutput(input_rotationangle_2)
input_robottype_2 = ClusterOutput(input_robottype)
input_robotconfiguration_3 = ClusterOutput(input_robotconfiguration_2)

# ==== cluster Series
L = ClusterInput()
lng = ListLength(List=L)
series = Series(Start="1", Step=1, Count=lng)
S = ClusterOutput(series)

# ==== cluster Cluster_4
output_adjustedpoints = ClusterInput()
input_rotationangle = ClusterInput()
output_adjustedpoints_2 = Data(output_adjustedpoints)
input_rotationangle_2 = Data(input_rotationangle)
xy = XYPlane(Origin=output_adjustedpoints_2)
deplane = DeconstructPlane(Plane=xy)  # -> Origin, XAxis, YAxis, ZAxis
rot3d = Rotate3D(Geometry=xy, Angle=degrees(input_rotationangle_2), Center=xy, Axis=deplane.XAxis)  # -> Geometry, Transform
output_basedpln = Data(rot3d.Geometry)
output_basedpln_2 = ClusterOutput(output_basedpln)

# ==== cluster Cluster_5
input_offsetdistance_mm = ClusterInput()
output_basedpln = ClusterInput()
input_offsetdistance_mm_2 = Data(input_offsetdistance_mm)
output_basedpln_2 = Data(output_basedpln)
pl_offset = PlaneOffset(BasePlane=output_basedpln_2, Offset=input_offsetdistance_mm_2)
output_offsetpln = Data(pl_offset)
output_offsetpln_2 = ClusterOutput(output_offsetpln)

# ==== cluster Cluster_8
V = ClusterInput()
intcrv = Interpolate(Vertices=V, Degree=3, Periodic=False, KnotStyle=1)  # -> reparameterize(Curve), Length, Domain
output_interpolatedcrv = Data(intcrv.Curve)
divlength = DivideLength(Curve=output_interpolatedcrv, Length=Slider(30, range=0..100))  # -> Points, Tangents, Parameters
output_interpolatedcrv_2 = ClusterOutput(output_interpolatedcrv)
lng = ListLength(List=divlength.Points)
range = Range(Domain=Domain(0, 1), Steps=lng)
hframe = HorizontalFrame(Curve=output_interpolatedcrv, Parameter=range)
output_splinepln = Data(hframe)
output_splinepln_2 = ClusterOutput(output_splinepln)

# ==== cluster Cluster_15
input_robot_tool = ClusterInput()
input_robot_speed = ClusterInput()
input_robotsystem = ClusterInput()

# ---- group: EstablishedJointPosition
input_jose_homeposition = Data(["0", "-90", "-90", "-90", "90", "0"])
input_robotsystem_2 = Data(input_robotsystem)

degtorad = DegreesToRadians(Degrees=input_jose_homeposition, RobotSystem=input_robotsystem_2, MechanicalGroup=0)
input_establishedjointposition = Data(degtorad)

# ---- group: EstablishedRobotTarget
input_establishedjointposition_2 = Data(input_establishedjointposition)
input_robot_tool_2 = Data(input_robot_tool)
input_robot_speed_2 = SpeedParameter(input_robot_speed)

target = CreateTarget(Joints=input_establishedjointposition_2, Tool=input_robot_tool_2, Speed=input_robot_speed_2, IsCartesian=False)
output_robottarget_homing = Data(target)

# ----
output_robottarget_homing_2 = ClusterOutput(output_robottarget_homing)
